# Grasshopper definition point_cloud.gh (Grasshopper 1.0.7)
# plug-ins: Human

pipeline = GeometryPipeline(
    GroupByLayer=False,
    GroupByType=False,
    IncludeHidden=True,
    IncludeLocked=True,
    LayerFilter="Stage_40",
    NameFilter="*",
    SublayerFiltering=True,
    TypeFilter=1)
stage_0 = Point([<point referenced from the Rhino model> x369])
stage_n = Point([<point referenced from the Rhino model> x369])
stage_0_2 = Point([<point referenced from the Rhino model> x369])
objatts = ObjectAttributes(ObjectOrAttributes=stage_n)  # -> Name, LayerName, LayerFullPath, Color, MaterialName, LinetypeName, GroupIndices, PlotWeight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

# ---- group: VECTOR DISPLAY
number_slider = Slider(61, range=0..100)
vec2pt = Vector2Pt(PointA=stage_0_2, PointB=stage_n, Unitize=False)  # -> Vector, Length
multiplication = Multiplication(A=vec2pt.Length, B=number_slider)
amp = Amplitude(Vector=vec2pt.Vector, Amplitude=multiplication)
division = Division(A=number_slider, B=Slider(45, range=0..100))
division_2 = Division(A=number_slider, B=Slider(15, range=0..100))
division_3 = Division(A=number_slider, B=Slider(7, range=0..100))
line = LineSDL(Start=stage_0_2, Direction=amp, Length=multiplication)
end = EndPoints(Curve=line)  # -> Start, End
pl = PlaneNormal(Origin=end.End, ZAxis=vec2pt.Vector)
pl_2 = PlaneNormal(Origin=end.Start, ZAxis=vec2pt.Vector)
cyl = Cylinder(Base=pl_2, Radius=division, Length=multiplication)
cone = Cone(Base=pl, Radius=division_2, Length=division_3)  # -> Cone, Tip
preview = CustomPreview(Geometry=[cyl, cone.Cone], Material=objatts.Color)

# ---- group: MESH
del = DelaunayMesh(Points=stage_n, Plane=PlaneXY(0, 0, 0))
demesh = DeconstructMesh(Mesh=del)  # -> Vertices, Faces, Colours, Normals
deface = DeconstructFace(Face=demesh.Faces)  # -> CornerA, CornerB, CornerC, CornerD
item = ListItem(List=demesh.Vertices, Index=deface.CornerC, Wrap=True)
item_2 = ListItem(List=demesh.Vertices, Index=deface.CornerA, Wrap=True)
item_3 = ListItem(List=demesh.Vertices, Index=deface.CornerB, Wrap=True)
fsim = FindSimilarMember(Data=item_3, Set=stage_n)  # -> Hit, Index
fsim_2 = FindSimilarMember(Data=item_2, Set=stage_n)  # -> Hit, Index
fsim_3 = FindSimilarMember(Data=item, Set=stage_n)  # -> Hit, Index
item_4 = ListItem(List=objatts.Color, Index=fsim_3.Index, Wrap=True)
item_5 = ListItem(List=objatts.Color, Index=fsim.Index, Wrap=True)
item_6 = ListItem(List=objatts.Color, Index=fsim_2.Index, Wrap=True)
conmesh = ConstructMesh(Vertices=demesh.Vertices, Faces=demesh.Faces, Colours=ColourSwatch(SwatchColor=RGBA(201, 201, 201, 170)))

# ---- group: EDGES
con = DelaunayEdges(Points=stage_n, Plane=PlaneXY(0, 0, 0))  # -> Connectivity, Edges
end_2 = EndPoints(Curve=con.Edges)  # -> Start, End
fsim_4 = FindSimilarMember(Data=end_2.End, Set=stage_n)  # -> Hit, Index
fsim_5 = FindSimilarMember(Data=end_2.Start, Set=stage_n)  # -> Hit, Index
item_7 = ListItem(List=objatts.Color, Index=fsim_5.Index, Wrap=True)
item_8 = ListItem(List=objatts.Color, Index=fsim_4.Index, Wrap=True)
preview_2 = CustomPreview(Geometry=con.Edges, Material=item_7)
